# Grasshopper definition Finger 2D.gh (Grasshopper 1.0.7)

unit_x = UnitX(Factor=Slider(8, range=0..10))
unit_x_2 = UnitX(Factor=Slider(45, range=0..100))
number_of_fingers = GetNumber(Slider(3, range=1..10), AtLeast=1, AtMost=1, Maximum=11, Minimum=1, Prompt="Number of fingers")
unit_y = UnitY(Factor=Slider(38, range=0..100))
construct_point = ConstructPoint(XCoordinate=unit_x, YCoordinate=0, ZCoordinate=0)
multiplication = Multiplication(A=number_of_fingers, B="2")
move = Move(Geometry=construct_point, Motion=unit_y)  # -> Geometry, Transform
move_2 = Move(Geometry=move.Geometry, Motion=unit_x_2)  # -> Geometry, Transform
addition = Addition(A=multiplication, B="1")
line = Line(StartPoint=construct_point, EndPoint=move_2.Geometry)
get_line = GetLine(line, AtLeast=1, AtMost=1, Realtime=True)
divide_curve = DivideCurve(Curve=get_line, Count=addition, Kinks=False)  # -> Points, Tangents, Parameters
material_thickness = Slider(3, range=0..10)
end_points = EndPoints(Curve=get_line)  # -> Start, End
kerf = Slider(0.115, range=0..1)
shatter = Shatter(Curve=get_line, Parameters=divide_curve.Parameters)
dispatch = Dispatch(List=shatter, DispatchPattern=[True, False])  # -> ListA, ListB
negative = Negative(Value=kerf)
extend_curve = ExtendCurve(Curve=dispatch.ListB, Type=0, Start=kerf, End=kerf)
radians = Radians(Degrees=Slider(270, range=0..360))
addition_2 = Addition(A=material_thickness, B=kerf)
construct_plane = ConstructPlane(Origin=Point(0, 0, 0), XAxis=end_points.End, YAxis=end_points.Start)
extend_curve_2 = ExtendCurve(Curve=dispatch.ListB, Type=0, Start=negative, End=negative)
end_points_2 = EndPoints(Curve=extend_curve)  # -> Start, End
radians_2 = Radians(Degrees=Slider(90, range=0..360))
xz_plane = XZPlane(Origin=Point(0, 0, 0))
xy_plane = XYPlane(Origin=end_points_2.End)
rotate = Rotate(Geometry=extend_curve, Angle=radians, Plane=xy_plane)  # -> Geometry, Transform
subtraction = Subtraction(A=material_thickness, B=kerf)
rotate_2 = Rotate(Geometry=construct_plane, Angle=1.570796327, Plane=xz_plane)  # -> Geometry, Transform
move_3 = Move(Geometry=rotate_2.Geometry, Motion=end_points.Start)  # -> Geometry, Transform
end_points_3 = EndPoints(Curve=extend_curve_2)  # -> Start, End
line_sdl = LineSDL(Start=end_points_2.End, Direction=rotate.Geometry, Length=addition_2)
xy_plane_2 = XYPlane(Origin=end_points_3.End)
rotate_3 = Rotate(Geometry=extend_curve_2, Angle=radians_2, Plane=xy_plane_2)  # -> Geometry, Transform
mirror = Mirror(Plane=move_3.Geometry)  # -> Geometry, Transform
end_points_4 = EndPoints(Curve=line_sdl)  # -> Start, End
context_bake = ContextBake(Geometry=mirror.Geometry)
line_sdl_2 = LineSDL(Start=end_points_3.End, Direction=rotate_3.Geometry, Length=subtraction)
rectangle_3pt = Rectangle3Pt(PointA=end_points_4.Start, PointB=end_points_4.End, PointC=end_points_2.Start)  # -> Rectangle, Length
end_points_5 = EndPoints(Curve=line_sdl_2)  # -> Start, End
context_bake_2 = ContextBake(Geometry=rectangle_3pt.Rectangle)
rectangle_3pt_2 = Rectangle3Pt(PointA=end_points_5.Start, PointB=end_points_5.End, PointC=end_points_3.Start)  # -> Rectangle, Length
context_bake_3 = ContextBake(Geometry=rectangle_3pt_2.Rectangle)
