# Grasshopper definition Halfsies reversed.gh (Grasshopper 1.0.7)

brep = Brep(<brep referenced from the Rhino model>)
brep_2 = Brep(<brep referenced from the Rhino model>)
get_geometry_out = GetGeometry(brep, AtLeast=2, AtMost=1, DeleteInput=True, Filter=1073741840, Prompt="Out")
get_geometry_inners = GetGeometry(brep_2, AtLeast=1, AtMost=200, DeleteInput=True, Filter=1073741840, Prompt="Inners")
cross_reference = CrossReference(ListListA=get_geometry_inners, ListListB=get_geometry_out, CrossMode=1)  # -> graft(ListListA), graft(ListListB)
weave = Weave(Pattern=[0, 1], Stream0=cross_reference.ListListA, Stream1=cross_reference.ListListB, NullGaps=False)
tree_statistics = TreeStatistics(Tree=weave)  # -> Paths, Length, Count
tree_branch = TreeBranch(Tree=weave, Path=tree_statistics.Paths, MaintainPaths=True)
panel = Panel(tree_branch)
dispatch = Dispatch(List=tree_branch, DispatchPattern=[True, False])  # -> ListA, ListB
logest_line_in_intersection = LogestLineInIntersection(A=dispatch.ListA, B=dispatch.ListB)
solid_intersection = SolidIntersection(BrepsA=dispatch.ListA, BrepsB=dispatch.ListB)
end_points = EndPoints(Curve=logest_line_in_intersection)  # -> Start, End
vector_2pt = Vector2Pt(PointA=end_points.Start, PointB=end_points.End, Unitize=False)  # -> Vector, Length
plane_normal = PlaneNormal(Origin=end_points.Start, ZAxis=vector_2pt.Vector)
division = Division(A=vector_2pt.Vector, B="2")
move = Move(Geometry=plane_normal, Motion=division)  # -> Geometry, Transform
brep_plane = BrepPlane(Brep=solid_intersection, Plane=move.Geometry)  # -> Curves, Points
split_brep = SplitBrep(Brep=solid_intersection, Cutter=brep_plane.Curves)
brep_closest_point = BrepClosestPoint(Point=end_points.Start, Brep=split_brep)  # -> Point, Normal, Distance
sort_list = SortList(Keys=brep_closest_point.Distance, ValuesValuesA=split_brep)  # -> Keys, ValuesValuesA
list_item = ListItem(List=sort_list.ValuesValuesA, Index="0", Wrap=True)
pt = ConstructPoint(
    XCoordinate=Slider(50000, range=0..100000),
    YCoordinate=Slider(50000, range=0..100000),
    ZCoordinate=Slider(50000, range=0..100000))
linear_array = LinearArray(Geometry=list_item, Direction=division, Count="2")  # -> Geometry, Transform
brep_closest_point_2 = BrepClosestPoint(Point=pt, Brep=linear_array.Geometry)  # -> Point, Normal, Distance
sort_list_2 = SortList(Keys=brep_closest_point_2.Distance, ValuesValuesA=linear_array.Geometry)  # -> Keys, reverse(ValuesValuesA)
cap_holes = CapHoles(Brep=sort_list_2.ValuesValuesA)
dispatch_2 = Dispatch(List=cap_holes, DispatchPattern=[True, False])  # -> ListA, ListB
solid_difference = SolidDifference(BrepsA=dispatch.ListB, BrepsB=dispatch_2.ListB)  # -> flatten(Result)
sort_list_3 = SortList(Keys=dispatch_2.ListA, ValuesValuesA=dispatch_2.ListA)  # -> Keys, ValuesValuesA
solid_difference_2 = SolidDifference(BrepsA=dispatch.ListA, BrepsB=sort_list_3.ValuesValuesA)
panel_2 = Panel(solid_difference)
split_list = SplitList(List=solid_difference, Index=Slider(1, range=0..1))  # -> ListA, ListB
context_bake = ContextBake(GeometryInners=solid_difference_2)
solid_intersection_2 = SolidIntersection(BrepsA=split_list.ListA, BrepsB=split_list.ListB)
panel_3 = Panel(split_list.ListA)
panel_4 = Panel(split_list.ListB)
combine_data = CombineData(Input0=solid_intersection_2, Input1=split_list.ListA)  # -> Result, Index
panel_5 = Panel(combine_data.Result)
context_bake_2 = ContextBake(Geometry=combine_data.Result)

# ==== cluster LogestLineInIntersection
A = ClusterInput()
B = ClusterInput()
sint = SolidIntersection(BrepsA=A, BrepsB=B)
edges = BrepEdges(Brep=sint)  # -> Naked, Interior, NonManifold
length = Length(Curve=edges.Interior)
sort_list = SortList(Keys=length, ValuesValuesA=edges.Interior)  # -> Keys, ValuesValuesA
reverse_list = ReverseList(List=sort_list.ValuesValuesA)
list_item = ListItem(List=reverse_list, Index=Slider(0, range=0..10), Wrap=True)
join = JoinCurves(Curves=list_item, Preserve=False)
simplify = SimplifyCurve(Curve=join)  # -> Curve, Simplified
explode = Explode(Curve=simplify.Curve, Recursive=True)  # -> Segments, Vertices
length_2 = Length(Curve=explode.Segments)
sort_list_2 = SortList(Keys=length_2, ValuesValuesA=explode.Segments)  # -> Keys, ValuesValuesA
reverse_list_2 = ReverseList(List=sort_list_2.ValuesValuesA)
list_item_2 = ListItem(List=reverse_list_2, Index=Slider(0, range=0..10), Wrap=True)
i = ClusterOutput(list_item_2)
