# Grasshopper definition Lay.gh (Grasshopper 1.0.7)
# plug-ins: OpenNest

brep = Brep([<brep referenced from the Rhino model> x2])
get_geometry = GetGeometry(brep, AtLeast=1, AtMost=500, DeleteInput=True, Filter=1073741840, TreeAccess=False)
deconstruct_brep = DeconstructBrep(Brep=get_geometry)  # -> Faces, Edges, Vertices
number_slider = Slider(300, range=0..10000)
tree_statistics = TreeStatistics(Tree=deconstruct_brep.Faces)  # -> Paths, Length, Count
tree_branch = TreeBranch(Tree=deconstruct_brep.Faces, Path=tree_statistics.Paths, MaintainPaths=True)
rectangle = Rectangle(Plane=PlaneXY(0, 0, 0), XSize=number_slider, YSize=number_slider, Radius=0)  # -> Rectangle, Length
planar = IsPlanar(Surface=tree_branch, Interior=True)  # -> Planar, Plane
cull = CullPattern(List=tree_branch, CullPattern=planar.Planar)
area = Area(Geometry=cull)  # -> Area, Centroid
m2d_parallel = Make2DParallelView(Projection=rectangle.Rectangle)
sort_list = SortList(Keys=area.Area, ValuesValuesA=cull)  # -> Keys, reverse(ValuesValuesA)
list_item = ListItem(List=sort_list.ValuesValuesA, Index="0", Wrap=True)  # -> flatten(Item)
plane = Plane(list_item)
plane_normal = PlaneNormal(Origin=plane, ZAxis=Vector(0, 0, 1))
rotate_direction = RotateDirection(Geometry=get_geometry, Center=Point(0, 0, 0), From=plane, To=plane_normal)  # -> Geometry, Transform
plane_normal_2 = PlaneNormal(Origin=Point(0, 0, 0), ZAxis=Vector(0, 0, 1))
number_slider_2 = Slider(589, range=0..1000)
neg = Negative(Value=number_slider_2)
pt = ConstructPoint(XCoordinate=0, YCoordinate=0, ZCoordinate=neg)
move_to_plane = MoveToPlane(Geometry=rotate_direction.Geometry, Plane=plane_normal_2, Above=True, Below=True)  # -> Geometry, Transform
xy = XYPlane(Origin=pt)
rectangle_2 = Rectangle(Plane=xy, XSize=number_slider_2, YSize=number_slider_2, Radius=0)  # -> Rectangle, Length
rectangle_3 = Rectangle(Plane=PlaneXY(0, 0, 0), XSize=Slider(790, range=0..1000), YSize=Slider(595, range=0..1000), Radius=0)  # -> Rectangle, Length
m2d_parallel_2 = Make2DParallelView(Projection=rectangle_2.Rectangle)
panel = Panel(m2d_parallel_2)
curve = Curve(rectangle_3.Rectangle)
opennest = OpenNest(
    Sheets=curve,
    Geo=move_to_plane.Geometry,
    Spacing=1,
    Placement=1,
    Tolerance=0.1,
    Rotations=4,
    Iterations=1,
    Seed=1,
    Reset=True,
    Run=False)  # -> Sheets, graft(Geo), ID, Transform, IDS
panel_2 = Panel(opennest.Geo)
make2d = Make2D(Geometry=opennest.Geo, View=m2d_parallel_2, TangentEdges=False, TangentSeams=False, AutoComputeMake2D=True)  # -> VisibleCurves, VisibleIndex, VisibleType, HiddenCurves, HiddenIndex, HiddenType
panel_3 = Panel(make2d.VisibleCurves)
join_curves = JoinCurves(Curves=make2d.VisibleCurves, Preserve=False)
group = Group(Objects=join_curves)
panel_4 = Panel(join_curves)
context_bake = ContextBake(Geometry=group)
panel_5 = Panel(group)
