# Grasshopper definition Living hinge.gh (Grasshopper 1.0.7)

line_spacing = Slider(2.9, range=0..10)
number_of_medium_cutis_n = Slider(2, range=0..10)
width = Slider(36, range=0..100)
depth = Slider(60, range=0..100)
height = Slider(3, range=0..10)
medium_cut_relative_lentgh = Slider(8, range=0..10)
space_relative = Slider(2, range=0..10)
get_number = GetNumber(
    line_spacing,
    {"2.9"}, selected=[],
    AtLeast=1,
    AtMost=1,
    Maximum=5000,
    Minimum=1,
    Prompt="Line Spacing",
    TreeAccess=False)
get_integer = GetInteger(
    number_of_medium_cutis_n,
    {"3"}, selected=[],
    AtLeast=1,
    AtMost=1,
    Maximum=2147483647,
    Minimum=-2147483648,
    Prompt="Get Number og medium cuts",
    TreeAccess=False)
get_number_2 = GetNumber(height, {"3"}, selected=[], AtLeast=1, AtMost=1, Maximum=5000, Minimum=1, Prompt="Z", TreeAccess=False)
get_number_3 = GetNumber(width, {"60"}, selected=[], AtLeast=1, AtMost=1, Maximum=5000, Minimum=1, Prompt="X", TreeAccess=False)
get_number_4 = GetNumber(depth, {"80"}, selected=[], AtLeast=1, AtMost=1, Maximum=5000, Minimum=1, Prompt="Y", TreeAccess=False)
num = Number(get_integer)
num_2 = Number(get_number)
num_3 = Number(get_number_3)
num_4 = Number(get_number_2)
num_5 = Number(get_number_4)
subtraction = Subtraction(A=num, B="1")
panel = Panel(num_3)
pt = Point(Point(0, 0, 0))
multiplication = Multiplication(A=space_relative, B=subtraction)
pt_2 = ConstructPoint(XCoordinate=num_3, YCoordinate=num_5, ZCoordinate=num_4)
multiplication_2 = Multiplication(A=num, B=medium_cut_relative_lentgh)
multiplication_3 = Multiplication(A=num, B=space_relative)
xy = XYPlane(Origin=Point(0, 0, 0))
xz = XZPlane(Origin=Point(0, 0, 0))
a_b_y = Addition(A=multiplication_2, B=multiplication)
division = Division(A=space_relative, B=a_b_y)
addition = Addition(A=medium_cut_relative_lentgh, B=space_relative)
division_2 = Division(A=medium_cut_relative_lentgh, B=a_b_y)
box = Box2Pt(PointA=pt, PointB=pt_2, Plane=xy)
subtraction_2 = Subtraction(A=a_b_y, B=multiplication_3)
multiplication_4 = Multiplication(A=num_3, B=division_2)
multiplication_5 = Multiplication(A=num_3, B=division)
division_3 = Division(A=addition, B=a_b_y)
multiplication_6 = Multiplication(A=num_3, B=division_3)
a_b_a = Division(A=subtraction_2, B=subtraction)
rectangle = Rectangle(Plane=xz, XSize=multiplication_4, YSize=num_4, Radius=0)  # -> Rectangle, Length
X = UnitX(Factor=multiplication_6)
addition_2 = Addition(A=a_b_a, B=space_relative)
division_4 = Division(A=a_b_a, B=a_b_y)
vec2pt = Vector2Pt(PointA=pt, PointB=X, Unitize=False)  # -> Vector, Length
division_5 = Division(A=addition_2, B=a_b_y)
a_b_length_a = Multiplication(A=num_3, B=division_4)
a_b_length_a_2 = Multiplication(A=num_3, B=division_5)
arrlinear = LinearArray(Geometry=rectangle.Rectangle, Direction=vec2pt.Vector, Count=num)  # -> Geometry, Transform
rectangle_2 = Rectangle(Plane=xz, XSize=a_b_length_a, YSize=num_4, Radius=0)  # -> Rectangle, Length
X_2 = UnitX(Factor=multiplication_5)
division_6 = Division(A=num_2, B="2")
division_7 = Division(A=num_5, B=num_2)
Y = UnitY(Factor=division_6)
move = Move(Geometry=rectangle_2.Rectangle, Motion=X_2)  # -> Geometry, Transform
Y_2 = UnitY(Factor=num_2)
X_3 = UnitX(Factor=a_b_length_a_2)
move_2 = Move(Geometry=move.Geometry, Motion=Y)  # -> Geometry, Transform
arrlinear_2 = LinearArray(Geometry=move_2.Geometry, Direction=X_3, Count=subtraction)  # -> Geometry, Transform
vec2pt_2 = Vector2Pt(PointA=pt, PointB=Y_2, Unitize=False)  # -> Vector, Length
round = Round(Number=division_7)  # -> Nearest, Floor, Ceiling
arrlinear_3 = LinearArray(Geometry=arrlinear.Geometry, Direction=vec2pt_2.Vector, Count=round.Ceiling)  # -> Geometry, Transform
arrlinear_4 = LinearArray(Geometry=arrlinear_2.Geometry, Direction=vec2pt_2.Vector, Count=round.Floor)  # -> Geometry, Transform
group = Group(Objects=[box, arrlinear_4.Geometry, arrlinear_3.Geometry])
context_bake = ContextBake(Geometry=group)
