# Grasshopper definition NameParts.gh (Grasshopper 1.0.7)
# plug-ins: OpenNest

get_geometry = GetGeometry(AtLeast=1, AtMost=200, DeleteInput=False, Filter=1074004029, TreeAccess=False)
geo = Geometry(get_geometry)
get_string = GetString({"ABC"}, selected=[], AtLeast=1, AtMost=1, Prompt="Name", TreeAccess=False)
id = Guid(geo)
txt = Text("ABC")
pt = ConstructPoint(
    XCoordinate=Slider(-1000, range=-1000..1000),
    YCoordinate=Slider(1000, range=-1000..1000),
    ZCoordinate=Slider(1000, range=-1000..1000))
rhinoobjects = RhinoObjects(GeometryAsGuid=id, T=0.01)  # -> Breps, GeometryAsGuid
brep_cp = BrepClosestPoint(Point=pt, Brep=rhinoobjects.Breps)  # -> Point, Normal, Distance
text = Text(Location=brep_cp.Point, Text=get_string, Size=1)
vec = VectorXYZ(XComponent=Slider(2, range=0..100), YComponent=Slider(-2, range=-20..0), ZComponent=0)  # -> Vector, Length
move = Move(Geometry=text, Motion=vec.Vector)  # -> Geometry, Transform
context_bake = ContextBake(Geometry=move.Geometry)
