# Grasshopper definition NestNonCurves.gh (Grasshopper 1.0.7)
# plug-ins: OpenNest

get_geometry = GetGeometry(AtLeast=1, AtMost=2000, DeleteInput=True, Filter=1074004029, TreeAccess=False)
geo = Geometry([<curve referenced from the Rhino model> x17])
ungroup = Ungroup(Group=geo)  # -> flatten(Objects)
id = Guid(ungroup)
rhinoobjects = RhinoObjects(GeometryAsGuid=id, T=0.01)  # -> Breps, GeometryAsGuid
rectangle = Rectangle(Plane=PlaneXY(0, 0, 0), XSize=Slider(790, range=0..1000), YSize=Slider(595, range=0..1000), Radius=0)  # -> Rectangle, Length
curve = Curve(rectangle.Rectangle)
opennest = OpenNest(
    Sheets=curve,
    Geo=rhinoobjects.Breps,
    Spacing=1,
    Placement=1,
    Tolerance=0.1,
    Rotations=4,
    Iterations=Slider(16, range=0..100),
    Seed=Slider(26, range=0..100),
    Reset=True,
    Run=False)  # -> Sheets, Geo, ID, Transform, IDS
tguid = TransformGuid(Guid=rhinoobjects.GeometryAsGuid, Transform=graft(opennest.Transform), Run=Toggle(False))
