# Grasshopper definition Overlap Fingers Reversed.gh (Grasshopper 1.0.8)

brep = Brep(<brep referenced from the Rhino model>)
brep_2 = Brep([<brep referenced from the Rhino model> x2])
get_geometry_out = GetGeometry(brep, AnnotationTypeFilter=0, AtLeast=1, AtMost=1, DeleteInput=True, Filter=1073741840, Prompt="In", TreeAccess=False)
get_geometry_inners = GetGeometry(
    brep_2,
    AnnotationTypeFilter=0,
    AtLeast=1,
    AtMost=200,
    DeleteInput=True,
    Filter=1073741840,
    Prompt="Outers",
    TreeAccess=False)
cross_reference = CrossReference(ListListA=get_geometry_inners, ListListB=get_geometry_out, CrossMode=1)  # -> graft(ListListA), graft(ListListB)
weave = Weave(Pattern=[0, 1], Stream0=cross_reference.ListListA, Stream1=cross_reference.ListListB, NullGaps=False)
tree_statistics = TreeStatistics(Tree=weave)  # -> Paths, Length, Count
tree_branch = TreeBranch(Tree=weave, Path=tree_statistics.Paths, MaintainPaths=True)
panel = Panel(tree_branch)
dispatch = Dispatch(List=tree_branch, DispatchPattern=[True, False])  # -> ListA, ListB
logest_line_in_intersection = LogestLineInIntersection(A=dispatch.ListA, B=dispatch.ListB)
length = Length(Curve=logest_line_in_intersection)
integer_division = IntegerDivision(A=length, B="50")
maximum = Maximum(A=integer_division, B="1")
multiplication = Multiplication(A=maximum, B="2")
solid_intersection = SolidIntersection(BrepsA=dispatch.ListA, BrepsB=dispatch.ListB)
end_points = EndPoints(Curve=logest_line_in_intersection)  # -> Start, End
addition = Addition(A=multiplication, B="1")
vector_2pt = Vector2Pt(PointA=end_points.Start, PointB=end_points.End, Unitize=False)  # -> Vector, Length
plane_normal = PlaneNormal(Origin=end_points.Start, ZAxis=vector_2pt.Vector)
division = Division(A=vector_2pt.Vector, B=addition)
move = Move(Geometry=plane_normal, Motion=division)  # -> Geometry, Transform
brep_plane = BrepPlane(Brep=solid_intersection, Plane=move.Geometry)  # -> Curves, Points
split_brep = SplitBrep(Brep=solid_intersection, Cutter=brep_plane.Curves)
brep_closest_point = BrepClosestPoint(Point=end_points.Start, Brep=split_brep)  # -> Point, Normal, Distance
sort_list = SortList(Keys=brep_closest_point.Distance, ValuesValuesA=split_brep)  # -> Keys, ValuesValuesA
list_item = ListItem(List=sort_list.ValuesValuesA, Index="0", Wrap=True)
linear_array = LinearArray(Geometry=list_item, Direction=division, Count=addition)  # -> Geometry, Transform
cap_holes = CapHoles(Brep=linear_array.Geometry)
dispatch_2 = Dispatch(List=cap_holes, DispatchPattern=[True, False])  # -> ListA, ListB
solid_difference = SolidDifference(BrepsA=dispatch.ListA, BrepsB=dispatch_2.ListB)  # -> flatten(Result)
panel_2 = Panel(solid_difference)
solid_difference_2 = SolidDifference(BrepsA=get_geometry_out, BrepsB=solid_difference)
context_bake = ContextBake(GeometryInners=solid_difference_2)
context_bake_2 = ContextBake(GeometryInners=solid_difference)

# ==== cluster LogestLineInIntersection
A = ClusterInput()
B = ClusterInput()
sint = SolidIntersection(BrepsA=A, BrepsB=B)
edges = BrepEdges(Brep=sint)  # -> Naked, Interior, NonManifold
length = Length(Curve=edges.Interior)
sort_list = SortList(Keys=length, ValuesValuesA=edges.Interior)  # -> Keys, ValuesValuesA
reverse_list = ReverseList(List=sort_list.ValuesValuesA)
list_item = ListItem(List=reverse_list, Index=Slider(0, range=0..10), Wrap=True)
join = JoinCurves(Curves=list_item, Preserve=False)
simplify = SimplifyCurve(Curve=join)  # -> Curve, Simplified
explode = Explode(Curve=simplify.Curve, Recursive=True)  # -> Segments, Vertices
length_2 = Length(Curve=explode.Segments)
sort_list_2 = SortList(Keys=length_2, ValuesValuesA=explode.Segments)  # -> Keys, ValuesValuesA
reverse_list_2 = ReverseList(List=sort_list_2.ValuesValuesA)
list_item_2 = ListItem(List=reverse_list_2, Index=Slider(0, range=0..10), Wrap=True)
i = ClusterOutput(list_item_2)
