# Grasshopper definition Solid Intersections.gh (Grasshopper 1.0.7)

brep = Brep([<brep referenced from the Rhino model> x2])
get_geometry = GetGeometry(brep, AtLeast=2, AtMost=500, DeleteInput=False, Filter=1073741840)
crossref = CrossReference(ListA=get_geometry, ListB=get_geometry, CrossMode=5)  # -> ListA, ListB
merge = Merge(Data1=graft(crossref.ListA), Data2=graft(crossref.ListB))
tstat = TreeStatistics(Tree=merge)  # -> Paths, Length, Count
branch = TreeBranch(Tree=merge, Path=tstat.Paths, MaintainPaths=True)
dispatch = Dispatch(List=branch, DispatchPattern=[True, False])  # -> ListA, ListB
sint = SolidIntersection(BrepsA=dispatch.ListA, BrepsB=dispatch.ListB)  # -> flatten(Result)
context_bake = ContextBake(Geometry=sint)
c_script = CSharpScript(TheList=sint)  # -> out, A; inputs TheList: list
# ---------- c_script: C# ----------
    RhinoApp.WriteLine("Number of Intersecting Solids: " + TheList.Count);
# ---------- end c_script ----------
